# Grasshopper definition AvantLeap_TechSnack_RhinoInside_1_Floors.gh (Grasshopper 1.0.7)
# plug-ins: Rhino.Inside for Autodesk Revit

# ----
# Avant Leap Technology Consulting
# "Tech Snacks"
# Rhino-Inside - Floors
# Building Outline
# Disclaimer:
# This script and other materials distributed by
# Avant Leap are for learning purposes only.
# Avant Leap bears no responsibility regarding
# any impact on schedule, cost, life / safety.
# Please use the script at your own discretion.
outline = Curve(<curve referenced from the Rhino model>)

# ----
# Feel free to reach out to us!
# www.avantleap.com
# info@avantleap.com
# Creating Floors
# Filter out floor types.
# Enable to delete element.
# Useful to avoid duplicate geometry.
# Select floor type.
# Create floor by specifying
# 1) Boundary
# 2) Floor Type
model = ModelCategoriesPicker({"Air Terminals": -2008013, "Analysis Display Style": -2000304, "Analysis Results": -2000303, "Areas": -2003200, "Bridge Abutments": -2006130, "Bridge Arches": -2006134, "Bridge Bearings": -2006138, "Bridge Cables": -2006133, "Bridge Decks": -2006135, "Bridge Foundations": -2006136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}, selected="Floors": -2000032)
types = QueryTypes(Category=model)
panel = Panel(types)
item = ListItem(List=types, Index="7", Wrap=True)
floor = AddFloor(Boundary=outline, Type=item)
delete = DeleteElement(Elements=floor)  # disabled
