# Grasshopper definition AvantLeap_TechSnack_RhinoInside_2_Columns.gh (Grasshopper 1.0.7)
# plug-ins: LunchBox, Rhino.Inside for Autodesk Revit

# ----
# Avant Leap Technology Consulting
# "Tech Snacks"
# Rhino-Inside - Columns
# Building Outline
# Disclaimer:
# This script and other materials distributed by
# Avant Leap are for learning purposes only.
# Avant Leap bears no responsibility regarding
# any impact on schedule, cost, life / safety.
# Please use the script at your own discretion.
outline = Curve(<curve referenced from the Rhino model>)

# ----
# Creating Columns
# Create surface out of floor boundary.
# Create gridlines.
# Note: Requires LunchBox module.
# Create lines to create columns
# Column spacing
# Column Height
# Filter out column types.
# Enable to delete element.
# Useful to avoid duplicate geometry.
# Select column type.
# Create columns by specifying:
# 1) Lines (can be vertical or slanted)
# 2) Column Type
model = ModelCategoriesPicker({"Air Terminals": -2008013, "Analysis Display Style": -2000304, "Analysis Results": -2000303, "Areas": -2003200, "Bridge Abutments": -2006130, "Bridge Arches": -2006134, "Bridge Bearings": -2006138, "Bridge Cables": -2006133, "Bridge Decks": -2006135, "Bridge Foundations": -2006136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}, selected="Structural Columns": -2001330)
# Feel free to reach out to us!
# www.avantleap.com
# info@avantleap.com
boundary = BoundarySurfaces(Edges=outline)
grid = GridStructure(Surface=boundary, UDivisions="8", VDivisions="5")  # -> StructureLines, StructureNodes
types = QueryTypes(Category=model)
pt = Point(grid.StructureNodes)
Z = UnitZ(Factor="30")
panel = Panel(types)
item = ListItem(List=types, Index="1", Wrap=True)
move = Move(Geometry=pt, Motion=Z)  # -> Geometry, Transform
ln = Line(StartPoint=pt, EndPoint=move.Geometry)
column = AddColumn(Curve=ln, Type=item)
delete = DeleteElement(Elements=column)  # disabled
