# Grasshopper definition AvantLeap_TechSnack_RhinoInside_3_Beams.gh (Grasshopper 1.0.7)
# plug-ins: LunchBox, Rhino.Inside for Autodesk Revit

# ----
# Avant Leap Technology Consulting
# "Tech Snacks"
# Rhino-Inside - Columns and beams
# Building Outline
outline = Curve(<curve referenced from the Rhino model>)

# ----
# Creating Columns
# Create surface out of floor boundary.
# Create gridlines.
# Note: Requires LunchBox module.
# Create lines to create columns
# Column spacing
# Column Height
# Filter out column types.
# Enable to delete element.
# Useful to avoid duplicate geometry.
# Select column type.
# Create columns by specifying:
# 1) Lines (can be vertical or slanted)
# 2) Column Type
model = ModelCategoriesPicker({"Air Terminals": -2008013, "Analysis Display Style": -2000304, "Analysis Results": -2000303, "Areas": -2003200, "Bridge Abutments": -2006130, "Bridge Arches": -2006134, "Bridge Bearings": -2006138, "Bridge Cables": -2006133, "Bridge Decks": -2006135, "Bridge Foundations": -2006136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}, selected="Structural Columns": -2001330)
# Feel free to reach out to us!
# www.avantleap.com
# info@avantleap.com
boundary = BoundarySurfaces(Edges=outline)
grid = GridStructure(Surface=boundary, UDivisions="8", VDivisions="5")  # -> StructureLines, StructureNodes
types = QueryTypes(Category=model)
pt = Point(grid.StructureNodes)
Z = UnitZ(Factor="30")
panel = Panel(types)
item = ListItem(List=types, Index="1", Wrap=True)
move = Move(Geometry=pt, Motion=Z)  # -> Geometry, Transform
ln = Line(StartPoint=pt, EndPoint=move.Geometry)
column = AddColumn(Curve=ln, Type=item)
delete = DeleteElement(Elements=column)  # disabled

# ----
# Creating Beams
# Here we used the same grid
# from creating columns.
# 2nd Floor Height
# Floor-to-Floor Height
# No. of Floors
# Filter out beams types
# (Structural Framing)
# Enable to delete element.
# Useful to avoid duplicate geometry.
# Disclaimer:
# This script and other materials distributed by
# Avant Leap are for learning purposes only.
# Avant Leap bears no responsibility regarding
# any impact on schedule, cost, life / safety.
# Please use the script at your own discretion.
# Select beam type.
# Create Beams by specifying:
# 1) Lines
# 2) Beam Type
model_2 = ModelCategoriesPicker({"Air Terminals": -2008013, "Analysis Display Style": -2000304, "Analysis Results": -2000303, "Areas": -2003200, "Bridge Abutments": -2006130, "Bridge Arches": -2006134, "Bridge Bearings": -2006138, "Bridge Cables": -2006133, "Bridge Decks": -2006135, "Bridge Foundations": -2006136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}, selected="Structural Framing": -2001320)
series = Series(Start="15", Step="15", Count="2")
Z_2 = UnitZ(Factor=series)
types_2 = QueryTypes(Category=model_2)
move_2 = Move(Geometry=grid.StructureLines, Motion=graft(Z_2))  # -> Geometry, Transform
panel_2 = Panel(types_2)
item_2 = ListItem(List=types_2, Index="0", Wrap=True)
panel_3 = Panel(move_2.Geometry)
beam = AddBeam(Curve=move_2.Geometry, Type=item_2)
delete_2 = DeleteElement(Elements=beam)  # disabled
